# Grasshopper definition bmw20170302.gh (Grasshopper 0.9.76)
# plug-ins: Python Interpreter

end = EndPoints(Curve=<geometry referenced from the Rhino model>)  # -> Start, End
pdecon = Deconstruct(Point=end.Start)  # -> XComponent, YComponent, ZComponent
number_slider = Slider(0.1, range=0..3)
subtraction = Subtraction(A=pdecon.ZComponent, B=10)
pipeline = GeometryPipeline(
    GroupByLayer=False,
    GroupByType=False,
    IncludeHidden=True,
    IncludeLocked=True,
    LayerFilter="right2",
    NameFilter="*",
    TypeFilter=4)
pipeline_2 = GeometryPipeline(
    GroupByLayer=False,
    GroupByType=False,
    IncludeHidden=True,
    IncludeLocked=True,
    LayerFilter="left2",
    NameFilter="*",
    TypeFilter=4)
pt = ConstructPoint(XCoordinate=0, YCoordinate=0, ZCoordinate=subtraction)
pipeline_3 = GeometryPipeline(
    GroupByLayer=False,
    GroupByType=False,
    IncludeHidden=True,
    IncludeLocked=True,
    LayerFilter="left1",
    NameFilter="*",
    TypeFilter=4)
pipeline_4 = GeometryPipeline(
    GroupByLayer=False,
    GroupByType=False,
    IncludeHidden=True,
    IncludeLocked=True,
    LayerFilter="right1",
    NameFilter="*",
    TypeFilter=4)
pipeline_5 = GeometryPipeline(
    GroupByLayer=False,
    GroupByType=False,
    IncludeHidden=True,
    IncludeLocked=True,
    LayerFilter="Track",
    NameFilter="*",
    TypeFilter=4)
xy = XYPlane(Origin=pt)
pipeline_6 = GeometryPipeline(
    GroupByLayer=False,
    GroupByType=False,
    IncludeHidden=True,
    IncludeLocked=True,
    LayerFilter="object",
    NameFilter="*",
    TypeFilter=1)
panel = Panel(pipeline)
panel_2 = Panel(pipeline_3)
panel_3 = Panel(pipeline_4)
panel_4 = Panel(pipeline_2)
panel_5 = Panel(pipeline_5)
list = ValueList({"reverse": 0, "not reverse": 1}, selected="not reverse")
divlength = DivideLength(Curve=pipeline_5, Length=number_slider)  # -> Points, Tangents, Parameters
pl = PlaneNormal(Origin=divlength.Points, ZAxis=divlength.Tangents)
rev = ReverseList(List=pl)
python = PythonScript(x=pipeline_5, reverse=list)  # -> out, a; inputs x: Curve, reverse: Int32
# ---------- python: Python ----------
import rhinoscriptsyntax as rs
if reverse==0:
    a=rs.CurveEndPoint(x)
elif reverse==1:
    a=rs.CurveStartPoint(x)
# ---------- end python ----------
rev_2 = ReverseList(List=divlength.Points)
filter = StreamFilter(Gate=list, Stream0=rev, Stream1=pl)
filter_2 = StreamFilter(Gate=list, Stream0=rev_2, Stream1=divlength.Points)
python_2 = PythonScript(
    truck_pts=filter_2,
    gap=number_slider,
    plans=filter,
    trackLane1=pipeline_5,
    left1=pipeline_3,
    right1=pipeline_4,
    right2=pipeline,
    left2=pipeline_2)  # -> out, section_pt; inputs truck_pts: list of Point3d, plans: list of Plane, curveLane1: list of Curve, trackLane1: list of Curve, left1: list of Curve, right1: list of Curve, right2: list of Curve, left2: list of Curve
# ---------- python_2: Python ----------
import rhinoscriptsyntax as rs
import Rhino.Geometry as rg

all_lanes_info=[]
section_pt=[]
size=len(plans)

for i in range(size):
    line_info=[]
    for c in trackLane1:
        intersect=rs.PlaneCurveIntersection(plans[i],c)
        if not intersect==None:
            
            for inter in intersect:
                info=[]
                info.append("0")
                info.append("center")
                info.append("")
                info.append("")
                info.append("")
                info.append("driving")
                line_info.append(info)
                print(line_info)
    for c in left1:
        intersect=rs.PlaneCurveIntersection(plans[i],c)
        if not intersect==None:
            
            for inter in intersect:
                info=[]
                d=rs.Distance(inter[1],truck_pts[i])
                info.append(str(d))
                info.append("left")
                info.append("80")
                info.append("solid")
                info.append("standard")
                info.append("driving")
                line_info.append(info)
                
    for c in left2:
        intersect=rs.PlaneCurveIntersection(plans[i],c)
        if not intersect==None:
            
            for inter in intersect:
                info=[]
                d=rs.Distance(inter[1],truck_pts[i])
                info.append(str(d))
                info.append("left")
                info.append("")
                info.append("")
                info.append("")
                info.append("driving")
                line_info.append(info)
    for c in right1:
        intersect=rs.PlaneCurveIntersection(plans[i],c)
        
        if not intersect==None:
            
            for inter in intersect:
                
                info=[]
                d=rs.Distance(inter[1],truck_pts[i])
                info.append(str(d))
                info.append("right")
                info.append("")
                info.append("")
                info.append("")
                info.append("driving")
                line_info.append(info)
                
    for c in right2:
        
        intersect=rs.PlaneCurveIntersection(plans[i],c)
        
        if not intersect==None:
            
            for inter in intersect:
                
                info=[]
                d=rs.Distance(inter[1],truck_pts[i])
                info.append(str(d))
                info.append("right")
                info.append("80")
                info.append("solid")
                info.append("standard")
                info.append("driving")
                line_info.append(info)
                
    for c in curveLane1:
        intersect=rs.PlaneCurveIntersection(plans[i],c)
        if not intersect==None:
            for inter in intersect:
                info=[]
                d=rs.Distance(inter[1],truck_pts[i])
                info.append(str(d))
                info.append("right")
                info.append("")
                info.append("")
                info.append("")
                info.append("driving")
                line_info.append(info)
    
    #remove duplicated data
    for i in range(len(line_info)):
        j=0
        size=len(line_info)-1
        while j<size:
            if abs(float(line_info[j][0])-float(line_info[j+1][0]))<0.05 and line_info[j][1]==line_info[j+1][1]:
                
                line_info.remove(line_info[j+1])
                size=size-1
            j=j+1
    #sort all data by distance
    for i in range(len(line_info)):
        for j in range(len(line_info)-1):
            if(float(line_info[j][0])>float(line_info[j+1][0])):
                l=line_info[j+1]
                line_info[j+1]=line_info[j]
                line_info[j]=l
    all_lanes_info.append(line_info)



## round all width
#allLanesWidth={}

#for i in range(len(all_lanes_info)):
#    for j in range(len(all_lanes_info[i])):
#        if all_lanes_info[i][j][-1]=="constantlane":
#            if not allLanesWidth.get(j):
#                allLanesWidth[j]=all_lanes_info[i][j][0]
#                
#            else:
#                
#                if abs(float(all_lanes_info[i][j][0])-float(allLanesWidth[j]))<0.1:
#                    all_lanes_info[i][j][0]=allLanesWidth[j]
#                else:
#                    allLanesWidth[j]=all_lanes_info[i][j][0]
#                    print(allLanesWidth)


#        if not lanewidth.get(j):
#            lanewidth[j]=all_lanes_info[i][j][0]
#            #(all_lanes_info[i][j]).append("new lane")
#        elif abs(float(all_lanes_info[i+1][j][0])-float(all_lanes_info[i][j][0]))>widthChangeThreshold:
#            lanewidth[j]=all_lanes_info[i+1][j][0]
#            #(all_lanes_info[i][j]).append("varied lane")
#            #print(i)
#        else:
#            all_lanes_info[i][j][0]=lanewidth[j]
#            #(all_lanes_info[i][j]).append("constant lane")
#    allLanesWidth.append(lanewidth)


## filter 
#detectPointNb=10

#for i in range(detectPointNb,len(all_lanes_info)-detectPointNb):
#    for j in range(len(all_lanes_info[i])):
#        isLaneChange=False
#        for k in range(1,detectPointNb):
#            if isLaneChange==False and len(all_lanes_info[i])==len(all_lanes_info[i-k]) and len(all_lanes_info[i])==len(all_lanes_info[i+k]):
#                if all_lanes_info[i-k][j][-1]=="varied lane" and all_lanes_info[i+k][j][-1]=="varied lane":
#                    isLaneChange=True
#                    all_lanes_info[i][j][-1]="varied lane"
def checkVariedLane(lineInfo):
    isVaried=False
    for i in range(len(lineInfo)):
        if lineInfo[i][-1]=="varied lane":
            isVaried=True
    return isVaried
def compareLaneSection(section1,section2,takeDistance=False):
    sameSection=[]
    if takeDistance:
        if len(section1)==len(section2):
            for i in range(len(section1)):
                for j in range(len(section2)):
                    if section1[i]==section2[j]:
                        sameSection.append(True)
            if len(sameSection)==len(section1):
                return True
            else:
                return False
        else:
            return False
    else:
        if len(section1)==len(section2):
            for i in range(len(section1)):
                for j in range(len(section2)):
                    if section1[i][1:]==section2[j][1:]:
                        sameSection.append(True)
            if len(sameSection)==len(section1):
                return True
            else:
                return False
        else:
            return False

for i in range(len(all_lanes_info)-1):
    if not compareLaneSection(all_lanes_info[i],all_lanes_info[i+1],False):

        section_pt.append(truck_pts[i])

f=open("C:/share/all_lanes_info.txt",'w')
print>>f,all_lanes_info
f.close()
# ---------- end python_2 ----------
python_3 = PythonScript(pts=divlength.Points, tans=divlength.Tangents, reverse=list)  # -> out, a; inputs pts: list of Point3d, tans: list of Vector3d, reverse: Int32
# ---------- python_3: Python ----------
import rhinoscriptsyntax as rs
if reverse==1:
    file=open("C:/share/points3D.txt",'w')
    for pt in pts:
        print>>file,str(pt.X)+","+str(pt.Y)+","+str(pt.Z)
    file.close()
    file=open("C:/share/tangent3D.txt",'w')
    for tan in tans:
        print>>file,str(tan.X)+","+str(tan.Y)+","+str(tan.Z)
    file.close()
elif reverse==0:
    file=open("C:/share/points3D.txt",'w')
    size=len(pts)
    for i in range(size):
        print>>file,str((pts[size-i-1]).X)+","+str((pts[size-i-1]).Y)+","+str((pts[size-i-1]).Z)
    file.close()
    file=open("C:/share/tangent3D.txt",'w')
    for i in range(size):
        print>>file,str((tans[size-i-1]).X)+","+str((tans[size-i-1]).Y)+","+str((tans[size-i-1]).Z)
    file.close()
# ---------- end python_3 ----------
